% Simulink data dictionary AutonomousSystem_Data.sldd

PerceptionBus = Simulink.Bus()
  Velocity: double[1 2]
  Position: double[1 2]
  Classification: Enum: ClassificationType
  TrackID: uint32

PlannerBus = Simulink.Bus()
  TargetSpeed: double
  TargetWaypoints: double[Inf 2]